# Grasshopper definition key_placement.gh (Grasshopper 1.0.7)
# plug-ins: Ivy

# ----
# PCB Offset from Plane
number_slider = Slider(3.5, range=0..10)

# ----
# Key Size
number_slider_2 = Slider(14, range=0..20)

# ----
# Collider
brep = Brep(<brep referenced from the Rhino model>)

# ----
# 1. Key Placement
# Key Placement Curves
crv = Curve([<curve referenced from the Rhino model> x5])

# ----
# Key Placement BRep
brep_2 = Brep(<brep referenced from the Rhino model>)

# ----
# Plate Hole Cutter
brep_3 = Brep(<brep referenced from the Rhino model>)

# ----
# Render Mesh
mesh = Mesh([<mesh referenced from the Rhino model> x5])

# ----
# Key Unit PCB Shape
curve = Curve([<curve referenced from the Rhino model> x2])

# ---- group: Multiply Colliders
number_slider_3 = Slider(3, range=0..10)
merge = Merge(Data1=number_slider_3, Data2=number_slider_3, Data3=number_slider_3, Data4=number_slider_3, Data5=number_slider_3)
series = Series(Start=0, Step=1, Count=merge)
mesh_2 = MeshBrep(
    Brep=brep,
    Settings={GridMaxCount=0, GridMinCount=16, JaggedSeams=False, MaxEdgeLength=0, MinEdgeLength=0.0001, MinTolerance=0, Refine=True, RefineAngle=0, RelativeTolerance=0.65, SimplePlanes=True, Tolerance=0})
long = LongestList(ListA=mesh_2, ListB=series, PaddingMode=2)  # -> ListA, ListB
long_2 = LongestList(ListA=graft(crv), ListB=long.ListA, PaddingMode=2)  # -> ListA, ListB

# ----
material = CreateMaterial(
    Diffuse=ColourSwatch(SwatchColor=RGB(128, 255, 0)),
    Specular=RGB(255, 254, 254),
    Emission=RGB(0, 0, 0),
    Transparency=0.7,
    Shine=0)
preview = CustomPreview(Geometry=brep_2, Material=material)

preview_2 = CustomPreview(Geometry=crv, Material=ColourSwatch(SwatchColor=RGB(255, 0, 0)))

# ---- group: Place Colliders on BRep
collider_mesh = Mesh(long_2.ListB)
crv_2 = Curve(crv)
brep_4 = Brep(brep_2)
c_script = CSharpScript(
    curves=crv_2,
    brep=brep_4,
    colliderMeshes=collider_mesh,
    epsilon=0.01,
    clashDistance=Slider(1, range=0..2),
    shouldKeysBeUpright=Toggle(False))  # -> out, Indices, Parameters, Planes, Curves; inputs curves: list of Curve, brep: Brep, colliderMeshes: tree of Mesh, epsilon: Double, clashDistance: Double, shouldKeysBeUpright: Boolean
# ---------- c_script: C# usings ----------
using Rhino.Geometry.Intersect;
using System.Linq;
# ---------- c_script: C# ----------
List<int> indices = new List<int>();
List<Mesh> colliders = new List<Mesh>();
List<double> parameters = new List<double>();
List<Plane> planes = new List<Plane>();
List<Curve> adjustedCurves = new List<Curve>();

// compute initial curve's colliders
Curve curve = projectToBrepAndTakeFirst(curves[0], brep);
adjustedCurves.Add(curves[0]);
List<Mesh> initialColliderMeshes = colliderMeshes.Branch(colliderMeshes.Path(0));
double[] initialCurveParameters = placeMeshesOnCurveOnSurface(
    curve,
    brep,
    initialColliderMeshes,
    epsilon,
    clashDistance
);
Plane[] initialCurvePlanes = initialCurveParameters.Select(x => computePlacementPlane(
brep,
curve,
x,
shouldKeysBeUpright
)).ToArray();
for(int i=0; i<initialCurvePlanes.Length; i++) {
    Mesh m = orient(initialColliderMeshes[i], initialCurvePlanes[i]);
    colliders.Add(m);
}
parameters.AddRange(initialCurveParameters);
planes.AddRange(initialCurvePlanes);
indices.AddRange(initialCurveParameters.Select(x => 0));

double tolerance = Rhino.RhinoDoc.ActiveDoc.ModelAbsoluteTolerance;
Point3d offsetDirectionPoint = curves[0].PointAtNormalizedLength(0.5);

for (int curveIndex = 1; curveIndex < curves.Count; curveIndex++) {
    List<Mesh> _colliderMeshes = colliderMeshes.Branch(colliderMeshes.Path(curveIndex));
    Curve _curve = curves[curveIndex];
    double initialOffset = 10; // FIXME: should be distance to the nearest point in any existing colliders

    int maxIteration = 20;
    double prevOffset = initialOffset;
    double offset = -initialOffset;

    Curve candidateCurve = _curve;
    double[] candidateCurveColliderPlacementParameters = new double[]{};
    Plane[] candidateCurveColliderPlacementPlanes = new Plane[]{};
    List<Mesh> candidateCurveColliders = new List<Mesh>();

    for (int iter=0; iter<maxIteration; iter++) {
        // offset curve and project
        Curve projectedCandidateCurve;
        if (offset == 0) {
            // offset fails when offset value is 0
            candidateCurve = _curve;
            projectedCandidateCurve = projectToBrepAndTakeFirst(candidateCurve, brep);
        }
        else {
            candidateCurve = _curve.Offset(
                offsetDirectionPoint,
                Vector3d.ZAxis,
                offset,
                tolerance,
                CurveOffsetCornerStyle.Round
            )[0];
            projectedCandidateCurve = projectToBrepAndTakeFirst(candidateCurve, brep);
        }

        // compute candidate curve's colliders
        candidateCurveColliderPlacementParameters = placeMeshesOnCurveOnSurface(
            projectedCandidateCurve,
            brep,
            _colliderMeshes,
            epsilon,
            clashDistance
        );
        candidateCurveColliderPlacementPlanes = candidateCurveColliderPlacementParameters.Select(
            x => computePlacementPlane(
            brep,
            projectedCandidateCurve,
            x,
            shouldKeysBeUpright)
        ).ToArray();
        candidateCurveColliders = new List<Mesh>();
        for (int i=0; i<candidateCurveColliderPlacementPlanes.Length; i++) {
            Mesh m = orient(_colliderMeshes[i], candidateCurveColliderPlacementPlanes[i]);
            candidateCurveColliders.Add(m);
        }

        MeshClash[] clashes = MeshClash.Search(colliders, candidateCurveColliders, clashDistance, 1);
        bool didMeshesClash = clashes.Length > 0;

        // end condition
        if (Math.Abs(offset - prevOffset) < epsilon && !didMeshesClash) {
            break;
        }

        // update offset
        double newOffset = offset;
        if (didMeshesClash) {
            newOffset -= Math.Abs(prevOffset - offset) / 2;
        }
        else  {
            newOffset += Math.Abs(prevOffset - offset) / 2;
        }
        prevOffset = offset;
        offset = newOffset;
    }

    adjustedCurves.Add(candidateCurve);
    colliders.AddRange(candidateCurveColliders);
    parameters.AddRange(candidateCurveColliderPlacementParameters);
    planes.AddRange(candidateCurveColliderPlacementPlanes);
    indices.AddRange(candidateCurveColliders.Select(x => curveIndex));
}

_Curves = adjustedCurves;
_Indices = indices;
_Parameters = parameters;
_Planes = planes;
# ---------- c_script: C# additional code ----------
Plane ComputeUprightPlane(Plane p) {
    Vector3d upVector = Vector3d.ZAxis;
    Vector3d x = Vector3d.CrossProduct(p.YAxis, upVector);
    return new Plane(p.Origin, x, p.YAxis);
}

double[] placeMeshesOnCurveOnSurface(
    Curve baseCurve,
    Brep brep,
    List<Mesh> colliderMeshes,
    double epsilon,
    double clashDistance
) {
    List<double> tt = new List<double>();
    tt.Add(baseCurve.Domain.T0);

    int maxIteration = 20;
    double tEpsilon = 0.001;
    for (int i=0; i<colliderMeshes.Count-1; i++) {

        Mesh mesh1 = colliderMeshes[i];
        Mesh mesh2 = colliderMeshes[i+1];

        // compute initial spacing
        BoundingBox boundingBox1 = mesh1.GetBoundingBox(Plane.WorldXY);
        BoundingBox boundingBox2 = mesh2.GetBoundingBox(Plane.WorldXY);
        double initialSpacing = boundingBox1.Max.X - boundingBox2.Min.X;

        // get last collider item
        double t1 = tt[i];
        Mesh collider1 = orient(mesh1, computePlacementPlane(brep, baseCurve, t1));
        double lastColliderOffset = baseCurve.GetLength(new Interval(baseCurve.Domain.T0, t1));
        if (lastColliderOffset == 0 && Math.Abs(baseCurve.Domain.T0 - t1) > tEpsilon) {
            // Failed to get length for last collider item.
            // Last collider item may fell out of baseCurve.
            Print("Failed to get length");
            break;
        }

        // extend baseCurve
        Curve _curve = baseCurve.Extend(CurveEnd.End, initialSpacing, CurveExtensionStyle.Smooth);

        // compute spacing by bisecting
        double prevSpacing = 0;
        double spacing = initialSpacing;
        bool didComputeSpacingSucceed = false;
        bool didMeshesClash = true;
        for (int iter=0; iter<maxIteration; iter++) {
            double _t;
            didComputeSpacingSucceed = _curve.LengthParameter(lastColliderOffset + spacing, out _t);
            if (!didComputeSpacingSucceed) {
                Print("Curve.LengthParameter failed. lastColliderOffset:" + lastColliderOffset.ToString());
                break;
            }
            Plane nextPlane = computePlacementPlane(brep, _curve, _t);
            Mesh collider2 = orient(mesh2, nextPlane);

            MeshClash[] clashes = MeshClash.Search(new Mesh[]{collider1}, new Mesh[]{collider2}, clashDistance, 1);
            didMeshesClash = clashes.Length > 0;

            // end condition
            if (Math.Abs(spacing - prevSpacing) < epsilon && !didMeshesClash) {
                break;
            }

            // update spacing
            double newSpacing = spacing;
            if (didMeshesClash) {
                newSpacing += Math.Abs(spacing - prevSpacing) / 2;
            }
            else {
                newSpacing -= Math.Abs(spacing - prevSpacing) / 2;
            }
            prevSpacing = spacing;
            spacing = newSpacing;
        }

        // write result
        if (didMeshesClash) {
            //Print(i.ToString() + ": Failed. Mesh clash remaining");
            break;
        }
        double tNext;
        _curve.LengthParameter(lastColliderOffset + spacing, out tNext);
        tt.Add(tNext);
    }

    return tt.ToArray();
}

Curve projectToBrepAndTakeFirst(
    Curve curve,
    Brep brep
) {
    Curve[] projectedCurves = Curve.ProjectToBrep(curve, brep, Vector3d.ZAxis, 0.001);
    double minZ = double.MaxValue;
    Curve c = projectedCurves[0];
    foreach (Curve _c in projectedCurves) {
        if (_c.PointAtStart.Z < minZ) {
            minZ = _c.PointAtStart.Z;
            c = _c;
        }
    }
    return c;
}

Mesh orient(Mesh mesh, Plane plane) {
    Mesh m = (Mesh)mesh.Duplicate();
    Transform transform = Transform.ChangeBasis(plane, Plane.WorldXY);
    m.Transform(transform);
    return m;
}

Plane computePlacementPlane(Brep brep, Curve curve, double t, bool upright=true) {
    Point3d p = curve.PointAt(t);
    Vector3d x = curve.TangentAt(t);

    // find closest point
    double maximumDistance = 10;
    Point3d closestPoint;
    ComponentIndex ci;
    double _s, _t;
    Vector3d normal;
    brep.ClosestPoint(p, out closestPoint, out ci, out _s, out _t, maximumDistance, out normal);

    Vector3d y = Vector3d.CrossProduct(x, normal);
    Plane plane = new Plane(p, -y, x);
    if (upright) {
        plane = ComputeUprightPlane(plane);
    }
    return plane;
}
# ---------- end c_script ----------
python = GhPythonScript(xx=c_script.Planes, yy=c_script.Indices)  # -> out, a; inputs xx: list, yy: list
# ---------- python: Python ----------
__author__ = "kaoru.yamaoka"

import rhinoscriptsyntax as rs
import ghpythonlib.treehelpers as th

result = [[] for x in range(max(yy)+1)];
for x, y in zip(xx, yy):
    result[y].append(x);
    
tree = th.list_to_tree(result)
a = tree
# ---------- end python ----------
project = Project(Curve=c_script.Curves, Brep=brep_4, Direction=Vector(0, 0, 1))
item = ListItem(List=project, Index=0, Wrap=True)
pshift = ShiftPaths(Data=item, Offset=-1)
key_placement_plane = Plane(python.a)
relocated_curve = Curve(c_script.Curves)
projected_curve = Curve(pshift)

# ----
# 2. PCB Unrolling (requires ivy)
# Key Placement Planes
key_placement_planes = Plane(key_placement_plane)

# ---- group: Display Curve Numbers
crv_3 = Curve(crv)
end = EndPoints(Curve=crv_3)  # -> Start, End
lng = ListLength(List=crv_3)
series_2 = Series(Start=0, Step=1, Count=lng)
tag = TextTag3D(Location=end.Start, Text=series_2, Size=5, Justification=7)

# ----
key_placement_plane_2 = Plane(key_placement_plane)

# ---- group: Extrusion Preview
merge_2 = Merge(Data1=graft(relocated_curve), Data2=graft(projected_curve))
loft = Loft(Curves=merge_2, Options={Adjust=False, Closed=False, LoftEnds=0, LoftSimp=0, LoftType=0, Rebuild=10, Refit=0.01})
material_2 = CreateMaterial(
    Diffuse=ColourSwatch(SwatchColor=RGB(0, 85, 255)),
    Specular=RGB(255, 254, 254),
    Emission=RGB(0, 0, 0),
    Transparency=0.7,
    Shine=0)
preview_3 = CustomPreview(Geometry=loft, Material=material_2)

# ----
orient = Orient(Geometry=graft(mesh), Source=PlaneXY(0, 0, 0), Target=flatten(key_placement_plane_2))  # -> Geometry, Transform
orient_2 = Orient(Geometry=brep_3, Source=PlaneXY(0, 0, 0), Target=key_placement_plane_2)  # -> Geometry, Transform
orient_3 = Orient(Geometry=brep, Source=PlaneXY(0, 0, 0), Target=key_placement_plane_2)  # -> Geometry, Transform

relocated_key_placement_curve = Data(relocated_curve)
key_placement_brep = Data(brep_2)
plate_hole_cutter = Data(orient_2.Geometry)
render_mesh = Data(orient.Geometry)
collider = Data(orient_3.Geometry)

key_placement_curve_on_brep = Data(projected_curve)

# ---- group: Collider Preview
material_3 = CreateMaterial(
    Diffuse=ColourSwatch(SwatchColor=RGB(255, 255, 255)),
    Specular=RGB(255, 254, 254),
    Emission=RGB(0, 0, 0),
    Transparency=0.6,
    Shine=0)
preview_4 = CustomPreview(Geometry=orient_3.Geometry, Material=material_3)

# ---- group: Render Model Preview
material_4 = CreateMaterial(
    Diffuse=ColourSwatch(SwatchColor=RGB(255, 255, 255)),
    Specular=RGB(255, 254, 254),
    Emission=RGB(0, 0, 0),
    Transparency=0.6,
    Shine=0)
preview_5 = CustomPreview(Geometry=orient.Geometry, Material=material_4)

# ---- group: Bake this
merge_3 = Merge(
    Data1=relocated_key_placement_curve,
    Data2=key_placement_curve_on_brep,
    Data3=key_placement_brep,
    Data4=collider,
    Data5=plate_hole_cutter,
    Data6=render_mesh)

# ---- group: Construct PCB
# Switch face vertex order:
# A from
# A to
# B to
# B from
# In most cases 1 is enough for bridge div
pt = ConstructPoint(XCoordinate=0, YCoordinate=0, ZCoordinate=expr("-x", number_slider))
cluster = Cluster_2(A=number_slider_2)  # -> bottom_left_2, top_left_2, bottom_right_2, top_right_2
xy = XYPlane(Origin=pt)
orient_4 = Orient(Geometry=xy, Source=PlaneXY(0, 0, 0), Target=key_placement_planes)  # -> Geometry, Transform
number_slider_4 = Slider(1, range=1..10)
item_2 = ListItem(List=orient_4.Geometry, Index=0, Wrap=True)
pshift_2 = ShiftPaths(Data=item_2, Offset=-1)
cluster_2 = Cluster(
    bridge_div=number_slider_4,
    planes=orient_4.Geometry,
    a_from=cluster.top_left_2,
    a_to=cluster.bottom_left_2,
    b_from=cluster.top_right_2,
    b_to=cluster.bottom_right_2)  # -> bridge_2, switch_2
lng_2 = ListLength(List=flatten(cluster_2.switch_2))
n_switch_mesh = Number(lng_2)

# ---- group: Construct PCB / Generate bridge between curves
cluster_3 = Cluster(
    bridge_div=number_slider_4,
    planes=pshift_2,
    a_from=cluster.top_left_2,
    a_to=cluster.top_right_2,
    b_from=cluster.bottom_left_2,
    b_to=cluster.bottom_right_2)  # -> bridge_2, switch_2

# ---- group: Construct PCB (continued)
merge_4 = Merge(Data1=flatten(cluster_2.switch_2), Data2=flatten(cluster_2.bridge_2), Data3=flatten(cluster_3.bridge_2))
mjoin = MeshJoin(Meshes=flatten(merge_4))
alignvert = AlignVertices(Mesh=mjoin, Tolerance=0.001)  # -> Result, Count
c_script_2 = CSharpScript(m=alignvert.Result)  # -> out, A; inputs m: Mesh
# ---------- c_script_2: C# ----------
m.Vertices.CombineIdentical(true, true);
m.UnifyNormals();
m.Normals.ComputeNormals();
A = m;
# ---------- end c_script_2 ----------
mesh_3 = Mesh(c_script_2.A)

# ---- group: Align faces up
facen = FaceNormals(Mesh=mesh_3)  # -> Centers, Normals
Z = UnitZ(Factor=1)
dprod = DotProduct(VectorA=facen.Normals, VectorB=Z, Unitize=False)
item_3 = ListItem(List=dprod, Index=0, Wrap=True)
smaller = SmallerThan(FirstNumber=item_3, SecondNumber=0)  # -> SmallerThan, OrEqualTo
flipm = FlipMesh(Mesh=mesh_3, VertexNormals=smaller.SmallerThan, FaceNormals=smaller.SmallerThan, FaceOrientation=smaller.SmallerThan)

# ----
material_5 = CreateMaterial(
    Diffuse=ColourSwatch(SwatchColor=RGB(27, 178, 82)),
    Specular=RGB(255, 254, 254),
    Emission=RGB(0, 0, 0),
    Transparency=0,
    Shine=0)
preview_6 = CustomPreview(Geometry=mesh_3, Material=material_5)

# ---- group: Unroll
grphmsh = GraphFromMesh(InputMesh=flipm)
mgurollviz = MeshGraphVisualUnroll(MeshGraph=grphmsh, StartFace=-1, Coefficient=1, RootDistance=0)  # -> Unfolded, RootPlane
mesh_4 = Mesh(mgurollviz.Unfolded)
deplane = DeconstructPlane(Plane=mgurollviz.RootPlane)  # -> Origin, XAxis, YAxis, ZAxis
X = UnitX(Factor=1)
project_2 = Project(Geometry=X, Plane=mgurollviz.RootPlane)  # -> Geometry, Transform
xprod = CrossProduct(VectorA=deplane.ZAxis, VectorB=project_2.Geometry, Unitize=False)  # -> Vector, Length
pl = ConstructPlane(Origin=deplane.Origin, XAxis=project_2.Geometry, YAxis=xprod.Vector)
orient_5 = Orient(Geometry=mesh_4, Source=pl, Target=PlaneXY(0, 0, 0))  # -> Geometry, Transform
alignvert_2 = AlignVertices(Mesh=orient_5.Geometry, Tolerance=0.01)  # -> Result, Count
c_script_3 = CSharpScript(m=alignvert_2.Result)  # -> out, A; inputs m: Mesh; same code as c_script_2

# ---- group: Mesh Face for Switch
demesh = DeconstructMesh(Mesh=c_script_3.A)  # -> Vertices, Faces, Colours, Normals
series_3 = Series(Start=0, Step=1, Count=n_switch_mesh)
item_4 = ListItem(List=demesh.Faces, Index=series_3, Wrap=True)

# ---- group: PCB Outline
medges = MeshEdges(Mesh=c_script_3.A)  # -> NakedEdges, InteriorEdges, NonManifoldEdges
crv_4 = Curve(medges.NakedEdges)
join = JoinCurves(Curves=crv_4, Preserve=False)

# ---- group: Switch Locations on Unrolled Plane
demesh_2 = DeconstructMesh(Mesh=c_script_3.A)  # -> Vertices, Faces, Colours, Normals
series_4 = Series(Start=0, Step=1, Count=n_switch_mesh)
item_5 = ListItem(List=demesh_2.Faces, Index=series_4, Wrap=True)
deface = DeconstructFace(Face=item_5)  # -> CornerA, CornerB, CornerC, CornerD
conmesh = ConstructMesh(Vertices=demesh_2.Vertices, Faces=graft(item_5))
item_6 = ListItem(List=demesh_2.Vertices, Index=deface.CornerB, Wrap=True)
item_7 = ListItem(List=demesh_2.Vertices, Index=deface.CornerC, Wrap=True)
item_8 = ListItem(List=demesh_2.Vertices, Index=deface.CornerA, Wrap=True)
area = Area(Geometry=conmesh)  # -> Area, Centroid
subtraction = Subtraction(A=item_7, B=item_6)
pshift_3 = ShiftPaths(Data=area.Centroid, Offset=-1)
subtraction_2 = Subtraction(A=item_8, B=item_6)
pl_2 = ConstructPlane(Origin=pshift_3, XAxis=subtraction, YAxis=subtraction_2)

# ---- group: Key Outlines
conmesh_2 = ConstructMesh(Vertices=demesh.Vertices, Faces=graft(item_4))
medges_2 = MeshEdges(Mesh=conmesh_2)  # -> NakedEdges, InteriorEdges, NonManifoldEdges
join_2 = JoinCurves(Curves=medges_2.NakedEdges, Preserve=False)

# ----
pcen = PolygonCenter(Polyline=join_2)  # -> CenterV, CenterE, CenterA
cir = Circle(Plane=pcen.CenterA, Radius=expr("x/2", Slider(5.5, range=0..10)))

orient_6 = Orient(Geometry=graft(curve), Source=PlaneXY(0, 0, 0), Target=pl_2)  # -> Geometry, Transform

key_outline = Curve(join_2)
key_center_circle = Curve(cir)
pcb_outline = Curve(join)
pcb_unit_shape = Curve(orient_6.Geometry)

material_6 = CreateMaterial(
    Diffuse=ColourSwatch(SwatchColor=RGB(27, 178, 82)),
    Specular=RGB(255, 254, 254),
    Emission=RGB(0, 0, 0),
    Transparency=0,
    Shine=0)
preview_7 = CustomPreview(Geometry=[pcb_outline, key_outline, key_center_circle], Material=material_6)

# ---- group: Bake this
merge_5 = Merge(Data1=key_outline, Data2=key_center_circle, Data3=pcb_outline, Data4=pcb_unit_shape)

# ==== cluster Cluster
bridge_div = ClusterInput()
planes = ClusterInput()
a_to = ClusterInput()
b_to = ClusterInput()
a_from = ClusterInput()
b_from = ClusterInput()
a_to_2 = Point(a_to)
bridge_div_2 = Integer(bridge_div)
planes_2 = Data(planes)
a_from_2 = Point(a_from)
b_from_2 = Point(b_from)
b_to_2 = Point(b_to)
cull_i = CullIndex(List=reverse(planes_2), Indices=0, Wrap=True)  # -> reverse(List)
cull_i_2 = CullIndex(List=planes_2, Indices=0, Wrap=True)

pln_to = Plane(cull_i_2)
pt_this_from = Point(a_from_2)
pln_from = Plane(cull_i)
pt_next_to = Point(a_to_2)
subtraction = Subtraction(A=pt_this_from, B=pt_next_to)
orient = Orient(Geometry=pt_this_from, Source=PlaneXY(0, 0, 0), Target=pln_from)  # -> Geometry, Transform
orient_2 = Orient(Geometry=pt_next_to, Source=PlaneXY(0, 0, 0), Target=pln_to)  # -> Geometry, Transform
unit = UnitVector(Vector=subtraction)
dist = Distance(PointA=orient.Geometry, PointB=orient_2.Geometry)
ln = Line(StartPoint=orient.Geometry, EndPoint=orient_2.Geometry)
orient_vec = OrientVec(G=unit, pln=pln_from)
orient_vec_2 = OrientVec(G=unit, pln=pln_to)
division = Division(A=dist, B=3)
multiplication = Multiplication(A=division, B=orient_vec)
multiplication_2 = Multiplication(A=division, B=orient_vec_2)
pt = Point(orient.Geometry)
pt_2 = Point(orient_2.Geometry)
addition = Addition(A=pt, B=multiplication)
subtraction_2 = Subtraction(A=pt_2, B=multiplication_2)
merge = Merge(Data1=graft(pt), Data2=graft(addition), Data3=graft(subtraction_2), Data4=graft(pt_2))
nurbs = NurbsCurve(Vertices=merge, Degree=3, Periodic=False)  # -> Curve, Length, Domain
divide = DivideCurve(Curve=ln, Count=bridge_div_2, Kinks=False)  # -> Points, Tangents, Parameters

pln_to_2 = Plane(cull_i_2)
pt_this_from_2 = Point(b_from_2)
pln_from_2 = Plane(cull_i)
pt_next_to_2 = Point(b_to_2)
subtraction_3 = Subtraction(A=pt_this_from_2, B=pt_next_to_2)
orient_3 = Orient(Geometry=pt_this_from_2, Source=PlaneXY(0, 0, 0), Target=pln_from_2)  # -> Geometry, Transform
orient_4 = Orient(Geometry=pt_next_to_2, Source=PlaneXY(0, 0, 0), Target=pln_to_2)  # -> Geometry, Transform
unit_2 = UnitVector(Vector=subtraction_3)
dist_2 = Distance(PointA=orient_3.Geometry, PointB=orient_4.Geometry)
ln_2 = Line(StartPoint=orient_3.Geometry, EndPoint=orient_4.Geometry)
orient_vec_3 = OrientVec(G=unit_2, pln=pln_from_2)
orient_vec_4 = OrientVec(G=unit_2, pln=pln_to_2)
division_2 = Division(A=dist_2, B=3)
multiplication_3 = Multiplication(A=division_2, B=orient_vec_3)
multiplication_4 = Multiplication(A=division_2, B=orient_vec_4)
pt_3 = Point(orient_3.Geometry)
pt_4 = Point(orient_4.Geometry)
addition_2 = Addition(A=pt_3, B=multiplication_3)
subtraction_4 = Subtraction(A=pt_4, B=multiplication_4)
merge_2 = Merge(Data1=graft(pt_3), Data2=graft(addition_2), Data3=graft(subtraction_4), Data4=graft(pt_4))
nurbs_2 = NurbsCurve(Vertices=merge_2, Degree=3, Periodic=False)  # -> Curve, Length, Domain
divide_2 = DivideCurve(Curve=ln_2, Count=bridge_div_2, Kinks=False)  # -> Points, Tangents, Parameters

merge_3 = Merge(Data1=pt_this_from, Data2=pt_next_to, Data3=b_to_2, Data4=b_from_2)
conmesh = ConstructMesh(Vertices=merge_3, Faces={A=0, B=1, C=2, D=3})
orient_5 = Orient(Geometry=conmesh, Source=PlaneXY(0, 0, 0), Target=planes_2)  # -> Geometry, Transform
c_script = CSharpScript(points1=divide.Points, points2=divide_2.Points)  # -> out, A; inputs points1: list of Point3d, points2: list of Point3d
# ---------- c_script: C# ----------
Mesh mesh = new Mesh();

mesh.Vertices.AddVertices(points1);
mesh.Vertices.AddVertices(points2);

for(int i=0; i<points1.Count-1; i++) {
    mesh.Faces.AddFace(i, i+1, i+points1.Count);
    mesh.Faces.AddFace(i+1+points1.Count, i+points1.Count, i+1);
}

mesh.Normals.ComputeNormals();
A = mesh;
# ---------- end c_script ----------
bridge = Mesh(c_script.A)
switch = Mesh(orient_5.Geometry)
switch_2 = ClusterOutput(switch)
bridge_2 = ClusterOutput(bridge)

# ==== cluster Cluster_2
A = ClusterInput()
division = Division(A=A, B=-2)
division_2 = Division(A=A, B=2)
pt = ConstructPoint(XCoordinate=division, YCoordinate=division, ZCoordinate=0)
pt_2 = ConstructPoint(XCoordinate=division, YCoordinate=division_2, ZCoordinate=0)
pt_3 = ConstructPoint(XCoordinate=division_2, YCoordinate=division, ZCoordinate=0)
pt_4 = ConstructPoint(XCoordinate=division_2, YCoordinate=division_2, ZCoordinate=0)
bottom_left = Point(pt)
top_left = Point(pt_2)
bottom_right = Point(pt_3)
top_right = Point(pt_4)
top_left_2 = ClusterOutput(top_left)
top_right_2 = ClusterOutput(top_right)
bottom_left_2 = ClusterOutput(bottom_left)
bottom_right_2 = ClusterOutput(bottom_right)

# ==== cluster OrientVec
pln = ClusterInput()
pln_2 = Plane(pln)
G = ClusterInput()
deplane = DeconstructPlane(Plane=pln_2)  # -> Origin, XAxis, YAxis, ZAxis
orient = Orient(Geometry=G, Source=PlaneXY(0, 0, 0), Target=pln_2)  # -> Geometry, Transform
subtraction = Subtraction(A=orient.Geometry, B=deplane.Origin)
R = ClusterOutput(subtraction)
